# Grasshopper definition p2m.gh (Grasshopper 1.0.7)
# plug-ins: Human

file_path = FilePath("C:\BACKUP\4.jpg")
ghpython_script = GhPythonScript(image_path=file_path, base_url="http://localhost:5000/p2m/")  # -> out, wall_polylines, walls
# ---------- ghpython_script: Python ----------
import urllib2
import json
import os

import Rhino.Geometry as rg


class WallGenerator:
    def __init__(self, base_url, path, height):
        self.base_url = base_url
        self.path = path.replace("\\", "/")
        self.url = base_url + path
        
        self.height = height
        
    def generate(self):
        self.wall_coordinates = self._get_wall_coordinates()
        self.wall_polylines = self._get_wall_polylines()
        self.walls = self._get_walls()
    
    def _get_wall_coordinates(self):
        request = urllib2.Request(self.url)
        response = urllib2.urlopen(request)
        
        return json.loads(response.read())["wall_coordinates"]
        
    def _get_wall_polylines(self):
        wall_polylines = []
        for coords in self.wall_coordinates:
            vertices = [rg.Point3d(coord[0], coord[1], 0) for coord in coords]
            wall_polyline = rg.PolylineCurve(vertices)
            wall_polylines.append(wall_polyline)
        
        return wall_polylines
        
    def _get_walls(self):
        walls = []
        
        extrusion_vector = rg.Vector3d(0, 0, self.height)
        for wall_polyline in self.wall_polylines:
            wall = rg.Extrusion.CreateExtrusion(wall_polyline, extrusion_vector)
            walls.append(wall)
            
        return walls



if __name__ == "__main__":
    
    wall_generator = WallGenerator(
        base_url=base_url, path=image_path, height=200
    )
    wall_generator.generate()
    
    wall_polylines = wall_generator.wall_polylines
    walls = wall_generator.walls
# ---------- end ghpython_script ----------
import_image = ImportImage(File=file_path)
point = Point(Point(0, 90.11153426, 0))
geometry = Geometry(ghpython_script.wall_polylines)
move = Move(Geometry=import_image, Motion=point)  # -> Geometry, Transform
explode = Explode(Curve=geometry, Recursive=True)  # -> flatten(Segments), Vertices
number_slider = Slider(205, range=0..205)
number_slider_2 = Slider(44.931, range=0..200)
construct_domain = ConstructDomain(DomainStart=0, DomainEnd=number_slider)
list_item = ListItem(List=explode.Segments, Index=number_slider, Wrap=True)
sub_list = SubList(List=explode.Segments, Domain=construct_domain, Wrap=True)  # -> List, Index
remap_numbers = RemapNumbers(Source=Domain(0, 1), Target=Domain(0, 1))  # -> Mapped, Clipped
custom_preview_lineweights = CustomPreviewLineweights(Geometry=sub_list.List, Shader=ColourSwatch(SwatchColor=RGB(0, 0, 0)), Thickness=1, Absolute=False)
explode_2 = Explode(Curve=sub_list.List, Recursive=True)  # -> flatten(Segments), Vertices
boundary_surfaces = BoundarySurfaces(Edges=explode_2.Segments)
point_2 = Point(Point(555.594641, 0, 0))
geometry_2 = Geometry(explode_2.Vertices)
move_2 = Move(Geometry=explode_2.Segments, Motion=point_2)  # -> Geometry, Transform
unit_z = UnitZ(Factor=number_slider)
custom_preview = CustomPreview(Geometry=boundary_surfaces, Material=ColourSwatch(SwatchColor=RGBA(8, 57, 156, 99)))
move_3 = Move(Geometry=move_2.Geometry, Motion=unit_z)  # -> Geometry, Transform
extrude = Extrude(Base=move_2.Geometry, Direction=unit_z)
boundary_surfaces_2 = BoundarySurfaces(Edges=move_3.Geometry)
