# Grasshopper definition facingpartsoftwobuildings.gh (Grasshopper 1.0.7)
# plug-ins: Human

number_slider = Slider(0, range=0..5)

# ---- group: building 1 data
co = Point([Point(14.93229128, 7.905032914, 0), Point(14.93229128, 0.1550329142, 0), Point(17.73229128, 0.1550329142, 0), Point(17.73229128, 7.905032914, 0)])
co_2 = Point([Point(14.93229128, 0.1550329142, 0), Point(17.73229128, 0.1550329142, 0), Point(17.73229128, 3.513143606, 0), Point(20.02197538, 3.513143606, 0), Point(20.02197538, 1.119556382, 0), Point(22.30048207, 1.119556382, 0), Point(22.30048207, -4.295997071, 0), Point(14.93229128, -4.295997071, 0), Point(14.93229128, 0.1550329142, 0)])
co_3 = Point([Point(17.73229128, 4.922797279, 0), Point(17.73229128, 3.513143606, 0), Point(20.02197538, 3.513143606, 0), Point(20.02197538, 1.119556382, 0), Point(22.30048207, 1.119556382, 0), Point(22.30048207, -2.695872061, 0), Point(24.65609387, -2.703235346, 0), Point(25.6203788, -2.161479949, 0), Point(25.6203788, 1.26718525, 0), Point(25.35675294, 4.922797279, 0), Point(17.73229128, 4.922797279, 0), Point(17.73229128, 3.513143606, 0)])
co_4 = Point([Point(17.73229128, 4.922797279, 0), Point(25.35675294, 4.922797279, 0), Point(25.06406057, 8.981464734, 0), Point(17.73229128, 8.981464734, 0)])
co_5 = Point([Point(14.93229128, 2.055032914, 0), Point(14.93229128, 0.1550329142, 0), Point(17.73229128, 0.1550329142, 0), Point(17.73229128, 2.055032914, 0), Point(14.93229128, 2.055032914, 0), Point(17.73229128, 0.1550329142, 0), Point(17.73229128, 2.055032914, 0), Point(14.93229128, 0.1550329142, 0)])
co_6 = Point([Point(14.93229145, 3.505032914, 0), Point(16.33229138, 3.505032914, 0), Point(16.33229138, 3.755032771, 0), Point(14.93229128, 3.755032771, 0), Point(14.93229128, 4.005032628, 0), Point(16.33229138, 4.005032628, 0)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])
co_7 = Point([Point(14.93229145, 3.505032914, 0), Point(16.33229138, 3.505032914, 0), Point(16.33229138, 6.582123698, 0), Point(17.73229128, 6.582123698, 0)])
polyline = PolyLine(Vertices=co, Closed=True)
polyline_2 = PolyLine(Vertices=co_2, Closed=True)
polyline_3 = PolyLine(Vertices=co_3, Closed=True)
polyline_4 = PolyLine(Vertices=co_4, Closed=True)
polyline_5 = PolyLine(Vertices=co_5, Closed=True)
polyline_6 = PolyLine(Vertices=co_6, Closed=False)
polyline_7 = PolyLine(Vertices=co_7, Closed=False)

# ----
ghpython_script = GhPythonScript()  # -> Out, A
offset_curve = OffsetCurve(Distance=1, Corners=1)
colour_swatch = ColourSwatch(SwatchColor=RGB(255, 0, 0))
merge = Merge(Data1=polyline, Data2=polyline_2, Data3=polyline_3, Data4=polyline_4)
offset_curve_2 = OffsetCurve(Curve=graft(merge), Distance=["-0.1", "0.1"], Corners=1)
custom_preview_lineweights = CustomPreviewLineweights(Geometry=offset_curve_2, Shader=ColourSwatch(SwatchColor=RGB(0, 0, 0)), Thickness=2, Absolute=False)
point = Point(Point(2.154144286, 14.48112158, 0))

# ---- group: building 2 data
co_8 = Point([Point(37.07127685, -6.772966626, 0), Point(37.07127685, -11.97296663, 0), Point(41.56605266, -11.97296663, 0), Point(41.56605266, -6.772966817, 0)])
co_9 = Point([Point(30.37848555, -6.772966626, 0), Point(39.05547977, -6.77296671, 0), Point(39.05547984, -5.280955524, 0), Point(35.8116834, -5.280955524, 0), Point(35.8116834, 0.2287245499, 0), Point(30.8834152, 0.2287245499, 0), Point(30.37848555, -6.772966626, 0)])
co_10 = Point([Point(39.05547977, -6.77296671, 0), Point(41.56605266, -6.772966817, 0), Point(41.56605266, 1.563888307, 0), Point(37.28749392, 1.563888307, 0), Point(37.28749392, 0.2287245499, 0), Point(35.8116834, 0.2287245499, 0), Point(35.8116834, -5.280955524, 0), Point(39.05547984, -5.280955524, 0), Point(39.05547977, -6.77296671, 0)])
co_11 = Point([Point(38.41327671, -6.772966683, 0), Point(38.41327671, -9.572966626, 0), Point(38.66327671, -9.572966626, 0), Point(38.66327671, -6.772966626, 0), Point(38.91327671, -6.772966642, 0), Point(38.91327671, -9.572966609, 0)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])
co_12 = Point([Point(37.07127685, -6.772966626, 0), Point(30.37848555, -6.772966626, 0), Point(30.16662055, -9.710827862, 0), Point(30.16662055, -13.38252819, 0), Point(33.83832088, -13.38252819, 0), Point(33.83832088, -12.90038573, 0), Point(37.07127685, -12.90038573, 0), Point(37.07127685, -6.772966626, 0)])
co_13 = Point([Point(39.66327628, -9.572966626, 0), Point(39.66327628, -11.97296663, 0), Point(41.56605266, -11.97296663, 0), Point(41.56605266, -9.572966626, 0), Point(39.66327628, -9.572966532, 0), Point(41.56605266, -11.97296663, 0), Point(39.66327628, -11.97296663, 0), Point(41.56605266, -9.572966626, 0)])
co_14 = Point([Point(39.66327628, -11.97296663, 0), Point(37.07127685, -11.97296663, 0), Point(37.07127685, -6.772966626, 0), Point(38.41327671, -6.772966683, 0), Point(38.41327671, -9.572966626, 0), Point(39.66327628, -9.572966626, 0), Point(39.66327628, -11.97296663, 0)])
polyline_8 = PolyLine(Vertices=co_8, Closed=True)
polyline_9 = PolyLine(Vertices=co_12, Closed=False)
polyline_10 = PolyLine(Vertices=co_9, Closed=False)
polyline_11 = PolyLine(Vertices=co_10, Closed=False)
polyline_12 = PolyLine(Vertices=co_13, Closed=False)
polyline_13 = PolyLine(Vertices=co_14, Closed=False)
polyline_14 = PolyLine(Vertices=co_11, Closed=False)

# ----
region_intersection = RegionIntersection()
merge_2 = Merge(Data1=polyline_8, Data2=polyline_9, Data3=polyline_10, Data4=polyline_11)
ghpython_script_2 = GhPythonScript(building_1_data=merge, building_2_data=merge_2)  # -> out, no_windows_area, a, b; inputs building_1_data: list of Curve, building_2_data: list of Curve
# ---------- ghpython_script_2: Python ----------
import Rhino.Geometry as rg
import ghpythonlib.components as gh
from ghpythonutils.utils.utils import LineHelper



class BuildingData(LineHelper):
    def __init__(self, data):
        """
            The first of the data should always be entered as `core`'s curve
            And all the other data should consist of `units` curve
        """
            
        self.data = data
        self.core = data[0]
        self.units = data[1:]
        
        self._gen_data(self.data, self.core, self.units)
        
    def _gen_data(self, data, core, units):
        """Generate basic geometries data from the building"""
        
        self.building_boundary = self._get_building_boundary(data)
        self.building_vertices = self.get_curve_vertices(self.building_boundary)
        
        self.building_rotated_bb = self._get_rotated_bounding_box(
            core, self.building_boundary
        )
        
        self.building_area_mass_properties = rg.AreaMassProperties.Compute(
            self.building_rotated_bb
        )
        
    def _get_building_boundary(self, data):
        """Assumes the length of `building_boundary` is just always one"""
        
        return rg.Curve.CreateBooleanUnion(data)[0]
        
    def _get_rotated_bounding_box(self, core, building_boundary):
        """Derivation of the bounding box created based on the `core_segment`"""
        
        return self.get_2d_obb_from_line(
            core.DuplicateSegments()[0], building_boundary
        ).ToNurbsCurve()
        
    def get_facing_part_estimators_with_other(self, other):
        buildings_facing_part_estimators = []
        
        coeff = 300
        rotated_bb_segments = self.building_rotated_bb.DuplicateSegments()
        for b1_seg in rotated_bb_segments:
            b1_seg_extended = self.get_extended_linestring(b1_seg, coeff, coeff)
            b1_seg_buffered = self.get_2d_buffered_linestring(
                b1_seg_extended, -coeff, is_single_side=True
            )
            
            diff = rg.Curve.CreateBooleanDifference(
                other.building_rotated_bb, b1_seg_buffered[0]
            )
            
            if len(diff) == 0:
                continue
                
            buildings_facing_part_estimators.extend(b1_seg_buffered)
        
        return buildings_facing_part_estimators


class BuildingDataResult(LineHelper):
    def __init__(self, building_1_data, building_2_data):
        """The length of the given buildings is fixed `2`"""
        
        self.building_1 = BuildingData(building_1_data)
        self.building_2 = BuildingData(building_2_data)
        
        self._gen_data_merged(self.building_1, self.building_2)
        
    def _gen_data_merged(self, building_1, building_2):
        """
            Merge two buildings data 
            and generate basic geometries to calculate `no_windows_area`
        """
        
        self.buildings_convex_hull = self._get_buildings_convex_hull(
            building_1.building_vertices, building_2.building_vertices
        )
        
        self.buildings_facing_part = self._get_buildings_facing_part(
            self.buildings_convex_hull, building_1, building_2
        )
        
    def _get_buildings_convex_hull(
            self, building_1_vertices, building_2_vertices
        ):
            return self.get_2d_convexhull(
                building_1_vertices + building_2_vertices
            )
            
    def _get_buildings_facing_part(
            self,
            buildings_convex_hull,
            building_1, 
            building_2, 
        ):
            
            self.buildings_facing_part_estimators = (
                building_1.get_facing_part_estimators_with_other(building_2)
                + building_2.get_facing_part_estimators_with_other(building_1)
            )
            
            if len(self.buildings_facing_part_estimators) < 5:
                return []
                
            union_estimators = rg.Curve.CreateBooleanUnion(
                self.buildings_facing_part_estimators
            )
            
            buildings_facing_part = union_estimators[1]
            
            buildings_facing_part = rg.Curve.CreateBooleanDifference(
                buildings_facing_part, 
                [self.building_1.building_boundary, self.building_2.building_boundary]
            )
            
            buildings_facing_part = list(buildings_facing_part)
            
            is_eroded = False
            if len(buildings_facing_part) == 1:
                buildings_facing_part_eroded = gh.OffsetCurve(
                    gh.BoundarySurfaces(buildings_facing_part),
                    0.1,
                    rg.Plane.WorldXY,
                    1
                )
                
                if (
                    not isinstance(buildings_facing_part_eroded, rg.PolylineCurve) 
                    and len(buildings_facing_part_eroded) > 1
                ):
                    is_eroded = True
                    buildings_facing_part = buildings_facing_part_eroded
                
                
            if len(buildings_facing_part) > 1:
                pi = 0
                while pi < len(buildings_facing_part):
                    
                    part = buildings_facing_part[pi]
                    
                    part_diff_b1_bb = rg.Curve.CreateBooleanDifference(
                        part, self.building_1.building_rotated_bb
                    )
                    
                    part_diff_b2_bb = rg.Curve.CreateBooleanDifference(
                        part, self.building_2.building_rotated_bb
                    )
                    
                    is_contains = 0 in (
                        len(part_diff_b1_bb), len(part_diff_b2_bb)
                    )
                    
                    if is_contains:
                        del buildings_facing_part[pi]
                        pi += -1
                    
                    else:
                        if is_eroded:
                             buildings_facing_part[pi] = gh.OffsetCurve(
                                gh.BoundarySurfaces(buildings_facing_part[pi]),
                                -0.1,
                                rg.Plane.WorldXY,
                                1
                             )
                    
                    pi += 1
                
            return buildings_facing_part



if __name__ == "__main__":
    buildings = BuildingDataResult(building_1_data, building_2_data)
    
    a = buildings.buildings_facing_part
    b = buildings.buildings_facing_part_estimators
# ---------- end ghpython_script_2 ----------
list_item = ListItem(List=ghpython_script_2.b, Index=number_slider, Wrap=True)
custom_preview_lineweights_2 = CustomPreviewLineweights(Geometry=ghpython_script_2.b, Shader=colour_swatch, Thickness=3, Absolute=False)
list_item_2 = ListItem(List=ghpython_script_2.b, Index=number_slider, Wrap=True)
boundary_surfaces = BoundarySurfaces(Edges=list_item)
boundary_surfaces_2 = BoundarySurfaces(Edges=ghpython_script_2.a)
list_item_3 = ListItem(List=ghpython_script_2.a, Index=Slider(14, range=0..14), Wrap=True)
custom_preview = CustomPreview(
    Geometry=[boundary_surfaces_2, ghpython_script_2.a],
    Material={diffuse=RGB(221, 160, 221), emission=RGB(66, 48, 66), shine=0.5, specular=RGB(255, 255, 255), transparency=0})
offset_curve_3 = OffsetCurve(Curve=boundary_surfaces_2, Distance=-0.1, Corners=1)
region_difference = RegionDifference(CurvesA=list_item, CurvesB=list_item_2)
custom_preview_lineweights_3 = CustomPreviewLineweights(Geometry=offset_curve_3, Shader=colour_swatch, Thickness=3, Absolute=False)
offset_curve_4 = OffsetCurve(Curve=graft(merge_2), Distance=["-0.1", "0.1"], Corners=1)
move = Move(
    Geometry=[polyline_8, polyline_9, polyline_10, polyline_11, polyline_12, polyline_13, polyline_14, offset_curve_4],
    Motion=point)  # -> Geometry, Transform; disabled
bounding_box = BoundingBox(Content=move.Geometry, Plane=PlaneXY(0, 0, 0), UnionBox=True)  # -> Box, Box_2; disabled
move_2 = Move(Geometry=[polyline_8, polyline_9, polyline_10, polyline_11], Motion=point)  # -> Geometry, Transform; disabled
number_slider_2 = Slider(17, range=0..100)  # disabled
colour_swatch_2 = ColourSwatch(SwatchColor=RGB(0, 0, 0))
area = Area(Geometry=bounding_box.Box)  # -> Area, Centroid; disabled
custom_preview_lineweights_4 = CustomPreviewLineweights(Shader=colour_swatch_2, Thickness=2, Absolute=False)
custom_preview_lineweights_5 = CustomPreviewLineweights(Geometry=offset_curve_4, Shader=colour_swatch_2, Thickness=2, Absolute=False)
rotate = Rotate(Geometry=move_2.Geometry, Angle=degrees(number_slider_2), Plane=area.Centroid)  # -> Geometry, Transform; disabled
