# Grasshopper definition kroomsclusters.gh (Grasshopper 1.0.7)
# plug-ins: Human

# ---- group: core
point = Point([Point(99.73913902, 7.790399127, 0), Point(102.1266606, 1.691035164, 0), Point(105.2927426, 2.930359338, 0), Point(102.9052211, 9.029723301, 0)])
point_2 = Point([Point(100.4317025, 6.021117977, 0), Point(100.9420125, 4.71743713, 0), Point(104.1080945, 5.956761304, 0), Point(103.5977846, 7.260442151, 0)])
polyline = PolyLine(Vertices=point, Closed=True)
polyline_2 = PolyLine(Vertices=point_2, Closed=True)

# ----
point_3 = Point([Point(87.78853375, 12.94273039, 0), Point(93.51272956, -1.680782989, 0), Point(113.3479533, 6.083473225, 0), Point(109.4102002, 16.14318934, 0)])

# ---- group: core
point_4 = Point([Point(139.4979311, 12.54167887, 0), Point(139.4979311, 7.891678874, 0), Point(145.0979311, 7.891678874, 0), Point(145.0979311, 12.54167887, 0)])
point_5 = Point([Point(139.4979311, 12.54167887, 0), Point(139.4979311, 11.14167887, 0), Point(145.0979311, 11.14167887, 0), Point(145.0979311, 12.54167887, 0)])
point_6 = Point([Point(139.4979311, 11.14167887, 0), Point(139.4979311, 9.241678874, 0), Point(142.2979311, 9.241678874, 0), Point(142.2979311, 11.14167887, 0)])
polyline_3 = PolyLine(Vertices=point_4, Closed=True)
polyline_4 = PolyLine(Vertices=point_5, Closed=True)
polyline_5 = PolyLine(Vertices=point_6, Closed=True)

# ----
point_7 = Point([Point(159.6159718, 25.26507987, 0), Point(134.4015959, 21.59753429, 0), Point(134.4015959, 7.891678874, 0), Point(159.6159718, 7.891678874, 0)])
polyline_6 = PolyLine(Vertices=point_3, Closed=True)
polyline_7 = PolyLine(Vertices=point_7, Closed=True)
number_slider = Slider(0, range=0..4)
ghpython_script = GhPythonScript(core=polyline, hall=polyline_2, floor=polyline_6)  # -> out, grid, krooms, floor, d, e, f; inputs core: Curve, hall: Curve, floor: Curve
# ---------- ghpython_script: Python ----------
# pylint: disable-all

import copy
import math

import Rhino.Geometry as rg
from ghpythonlib.components import ShortestWalk

from ghpythonutils.utils.kmeans.kmeans import KMeans
from ghpythonutils.utils.dijkstra.dijkstra import Dijkstra
from ghpythonutils.utils.utils import ConstsCollection, LineHelper, PointHelper


class Room(ConstsCollection):
    """Dataclass to each room"""

    def __init__(self, cells, floor_boundary):
        self.cells = cells
        self.floor_boundary = floor_boundary
        self.room = rg.Curve.CreateBooleanUnion(self.cells)[0]
        self._gen_boundary_points()

        ConstsCollection.__init__(self)

    def is_connected_to_corridor(self, corridor):
        intersections = rg.Intersect.Intersection.CurveCurve(
            self.room, corridor, self.TOLERANCE, self.TOLERANCE
        )
        return len(intersections) > 0
        
    def _gen_boundary_points(self):
        self.boundary_points = []
        for cell in self.cells:
            cell_vertices = LineHelper.get_curve_vertices(cell)
            for cell_vertex in cell_vertices:
                is_overlap = (
                    rg.Curve.Contains(self.room, cell_vertex, rg.Plane.WorldXY)
                    == rg.PointContainment.Coincident
                )
                
                for boundary in self.floor_boundary:
                    is_floor_overlap = (
                        rg.Curve.Contains(
                            boundary, cell_vertex, rg.Plane.WorldXY
                        ) == rg.PointContainment.Coincident
                    )
                
                    if is_overlap and not is_floor_overlap:
                        self.boundary_points.append(cell_vertex)


class Boundary:
    """
    _description_
    """

    def __init__(self, boundary, target_area):
        self.boundary = boundary
        self.boundary_area = rg.AreaMassProperties.Compute(boundary).Area
        self.target_area = target_area

        self._gen_estimated_k()

    def _gen_estimated_k(self):
        """The K is given floor area divided target area."""
        assert self.target_area > 0, "Target area is less than zero"
        self.k = int(self.boundary_area / self.target_area)


class KRoomsCluster(KMeans, PointHelper, LineHelper, ConstsCollection):
    """
    To use the inherited moduels, refer the link below.
    https://github.com/PARKCHEOLHEE-lab/GhPythonUtils
    """

    def __init__(self, floor, core, hall, target_area, axis=None):
        self.floor = floor
        self.core = core
        self.hall = hall
        self.sorted_hall_segments = self.get_sorted_segment(self.hall)
        self.target_area = target_area
        self.axis = axis

        KMeans.__init__(self)
        PointHelper.__init__(self)
        LineHelper.__init__(self)
        ConstsCollection.__init__(self)

    def get_predicted_rooms(self):
        self._is_disjoint_floor_and_core()

        self._gen_given_axis_aligned_obb()
        self._gen_boundaries()
        self._gen_estimated_grid_size()
        self._gen_grid()
        self._gen_predicted_rooms()
        self._gen_corridor()
#        self._gen_connected_rooms_to_corridor()

        return [room.room for room in self.rooms]

    def _is_disjoint_floor_and_core(self):
        is_disjoint = (
            rg.Curve.PlanarClosedCurveRelationship(
                self.floor, self.core, rg.Plane.WorldXY, self.TOLERANCE
            )
            == rg.RegionContainment.Disjoint
        )

        assert not is_disjoint, "Given floor and core are disjoint"

    def _gen_given_axis_aligned_obb(self):
        if self.axis is None:
            self.axis = self.core.DuplicateSegments()[0]

        self.obb = self.get_2d_obb_from_line(
            self.axis, self.floor
        ).ToNurbsCurve()

        if (
            self.obb.ClosedCurveOrientation()
            != rg.CurveOrientation.CounterClockwise
        ):
            self.obb.Reverse()

    def _gen_boundaries(self):
        self.diff_floor = rg.Curve.CreateBooleanDifference(
            self.floor, self.core
        )

        self.boundaries = []
        for boundary in self.diff_floor:
            boundary_object = Boundary(boundary, self.target_area)
            self.boundaries.append(boundary_object)

    def _gen_estimated_grid_size(self):
        hall_shortest_segment = self.sorted_hall_segments[0]
        self.grid_size = hall_shortest_segment.GetLength()

    def _gen_grid(self):
        self.base_rectangles = [
            self.get_2d_offset_polygon(seg, self.grid_size)
            for seg in self.sorted_hall_segments[:2]
        ]

        counts = []
        planes = []
                
        for ri, base_rectangle in enumerate(self.base_rectangles):
            x_vector = (
                rg.AreaMassProperties.Compute(base_rectangle).Centroid
                - rg.AreaMassProperties.Compute(self.hall).Centroid
            )

            y_vector = copy.copy(x_vector)
            y_transform = rg.Transform.Rotation(
                math.pi * 0.5,
                rg.AreaMassProperties.Compute(base_rectangle).Centroid,
            )
            y_vector.Transform(y_transform)

            base_rectangle.Translate(
                (
                    self.sorted_hall_segments[0].PointAtStart
                    - self.sorted_hall_segments[0].PointAtEnd
                )
                / 2
            )
            
            base_rectangle.Translate(
                self.get_normalized_vector(x_vector) * -self.grid_size / 2
            )

            anchor = rg.AreaMassProperties.Compute(base_rectangle).Centroid
            plane = rg.Plane(
                origin=anchor,
                xDirection=x_vector,
                yDirection=y_vector,
            )

            x_proj = self.get_projected_point_on_curve(
                anchor, plane.XAxis, self.obb
            )

            x_count = (
                int(math.ceil(x_proj.DistanceTo(anchor) / self.grid_size)) + 1
            )

            y_projs = [
                self.get_projected_point_on_curve(
                    anchor, plane.YAxis, self.obb
                ),
                self.get_projected_point_on_curve(
                    anchor, -plane.YAxis, self.obb
                ),
            ]

            y_count = [
                int(math.ceil(y_proj.DistanceTo(anchor) / self.grid_size)) + 1
                for y_proj in y_projs
            ]

            planes.append(plane)
            counts.append([x_count] + y_count)

        x_grid = []
        for base_rectangle, count, plane in zip(
            self.base_rectangles, counts, planes
        ):
            xc, _, _ = count

            for x in range(xc):
                copied_rectangle = copy.copy(base_rectangle)
                vector = plane.XAxis * self.grid_size * x
                copied_rectangle.Translate(vector)
                x_grid.append(copied_rectangle)

        y_vectors = [planes[0].YAxis, -planes[0].YAxis]
        y_counts = counts[0][1:]
        all_grid = [] + x_grid
        for rectangle in x_grid:
            for y_count, y_vector in zip(y_counts, y_vectors):
                for yc in range(1, y_count):
                    copied_rectangle = copy.copy(rectangle)
                    vector = y_vector * self.grid_size * yc
                    copied_rectangle.Translate(vector)
                    all_grid.append(copied_rectangle)
        
        union_all_grid = rg.Curve.CreateBooleanUnion(all_grid, self.TOLERANCE)
        
        for y_count, y_vector in zip(y_counts, y_vectors):
            for yc in range(1, y_count):
                copied_hall = copy.copy(self.hall)
                copied_hall.Translate(
                    (
                        self.sorted_hall_segments[0].PointAtStart
                        - self.sorted_hall_segments[0].PointAtEnd
                    )
                    / 2
                )
                
                vector = y_vector * self.grid_size * yc
                copied_hall.Translate(vector)
                all_grid.extend(
                    rg.Curve.CreateBooleanDifference(
                        copied_hall, union_all_grid
                    )
                )
                
        self.grid = []
        for grid in all_grid:
            for boundary in self.boundaries:
                tidied_grid = list(
                    rg.Curve.CreateBooleanIntersection(
                        boundary.boundary, grid, self.TOLERANCE
                    )
                )
                
                self.grid.extend(tidied_grid)
        self.grid_centroids = [
            rg.AreaMassProperties.Compute(g).Centroid for g in self.grid
        ]

    def _gen_predicted_rooms(self):
        self.points = self.grid_centroids
        self.k = self.boundaries[0].k

        _, indices = self.predict(get_indices=True)

        self.rooms = []
        self.clusters = []
        for each_indices in indices:
            cells = []
            for index in each_indices:
                cells.append(self.grid[index])
            
            self.clusters.append(cells)
            self.rooms.append(Room(cells, self.diff_floor))
            
    def _gen_corridor(self):
        self.start_point_candidates = [
            s.PointAtLength(s.GetLength() / 2) 
            for s in self.sorted_hall_segments[:2]
        ]
        
        self.inaccessible_rooms = []
        for ri, room in enumerate(self.rooms):
            is_connected_to_corridor = room.is_connected_to_corridor(self.hall)
            if not is_connected_to_corridor:
                self.inaccessible_rooms.append(room)

        hall_centroid = rg.AreaMassProperties.Compute(self.hall).Centroid
        sorted_inaccessible_rooms = sorted(
            self.inaccessible_rooms,
            key=lambda r: rg.AreaMassProperties.Compute(r.room).Centroid.DistanceTo(
                hall_centroid
            ),
            reverse=True,
        )
        
        self.network = []
        for grid_segment in self.get_removed_overlapped_curves(self.grid):
            intersections = rg.Intersect.Intersection.CurveCurve(
                grid_segment, self.core, self.TOLERANCE, self.TOLERANCE
            )
            
            for intersect in intersections:
                if not intersect.IsOverlap:
                    self.network.append(grid_segment)
            
            if len(intersections) < 1:
                self.network.append(grid_segment)
            
        self.corridor = [self.hall]
        self.asdf = []
        for inaccessible_room in sorted_inaccessible_rooms:
            if inaccessible_room.is_connected_to_corridor(self.corridor[0]):
                continue

            ic = rg.AreaMassProperties.Compute(inaccessible_room.room).Centroid
            start_point = sorted(
                self.start_point_candidates, key=lambda p: p.DistanceTo(ic)
            )[0]
            
            room_points = rg.PointCloud(inaccessible_room.boundary_points)
            closest_index = room_points.ClosestPoint(start_point)
            target_point = inaccessible_room.boundary_points[closest_index]
            
            dijkstra = Dijkstra(self.network, start_point, target_point)
            corridor_line = rg.Curve.JoinCurves(dijkstra.shortest_path)[0]
            
            print(corridor_line)
            
            each_corridor = self.get_2d_buffered_linestring(
                corridor_line, self.grid_size
            )[0]
            
            self.corridor.append(each_corridor)
            
        self.corridor = rg.Curve.CreateBooleanUnion(self.corridor)

        self.krooms = []
        for room in self.rooms:
            self.krooms.extend(
                list(
                    rg.Curve.CreateBooleanDifference(
                        room.room, self.corridor[0]
                    )
                )
            )

if __name__ == "__main__":
    krsc = KRoomsCluster(
        floor=floor,
        core=core,
        hall=hall,
        target_area=20,
    )

    krooms = krsc.get_predicted_rooms()
    grid = krsc.grid
    
    
    import ghpythonlib.treehelpers as gt
    d = krsc.corridor
#    e = gt.list_to_tree([kroom.boundary_points for kroom in krsc.rooms])
    f = gt.list_to_tree(krsc.clusters)
# ---------- end ghpython_script ----------
geometry = Geometry(ghpython_script.d)
boundary_surfaces = BoundarySurfaces(Edges=ghpython_script.d)
colour_swatch = ColourSwatch(SwatchColor=RGB(0, 0, 0))
data = Data(ghpython_script.grid)
custom_preview_lineweights = CustomPreviewLineweights(Geometry=ghpython_script.krooms, Shader=colour_swatch, Thickness=2, Absolute=False)
list_item = ListItem(List=ghpython_script.grid, Index=Slider(154, range=0..160), Wrap=True)
custom_preview_lineweights_2 = CustomPreviewLineweights(Geometry=ghpython_script.e, Shader=ColourSwatch(SwatchColor=RGB(255, 0, 0)), Thickness=5, Absolute=False)
custom_preview_lineweights_3 = CustomPreviewLineweights(Geometry=[ghpython_script.floor, polyline], Shader=colour_swatch, Thickness=3, Absolute=False)
custom_preview_lineweights_4 = CustomPreviewLineweights(Geometry=list_item, Shader=ColourSwatch(SwatchColor=RGB(0, 255, 102)), Thickness=5, Absolute=False)
area = Area(Geometry=ghpython_script.grid)  # -> Area, Centroid
list_item_2 = ListItem(List=ghpython_script.krooms, Index=Slider(1, range=0..4), Wrap=True)
point_8 = Point(Point(40.0736965, 0, 0))
move = Move(Geometry=ghpython_script.f, Motion=point_8)  # -> Geometry, Transform
move_2 = Move(Geometry=[ghpython_script.krooms, polyline], Motion=point_8)  # -> Geometry, Transform
move_3 = Move(Geometry=[polyline, polyline_2, polyline_6, ghpython_script.grid, area.Centroid], Motion=point_8)  # -> Geometry, Transform
multiplication = Multiplication(A=point_8, B=2)
ghpython_script_2 = GhPythonScript()  # -> out, a
# ---------- ghpython_script_2: Python ----------
import copy
import math

import Rhino.Display as rd
import Rhino.Geometry as rg

CUSTOM_DISPLAY = "custom_display"


class ConstsCollection:
    TOLERANCE = 0.001

    HALF = 0.5
    INF = 1e15


class ColorsCollection:
    COLOR_BLACK = rd.ColorHSL(1, 0, 0, 0)
    COLOR_GRAY = rd.ColorHSL(0.5, 0, 0, 0.5)
    COLOR_RED = rd.ColorHSL(1, 0, 1, 0.5)
    COLOR_GREEN = rd.ColorHSL(1, 0.333, 1, 0.5)
    COLOR_BLUE = rd.ColorHSL(1, 0.666, 1, 0.5)


class Enum:
    @staticmethod
    def enum(*names):
        """Enumerated type creation helper

        Returns:
            Enum: custom enumerated type
        """

        enums = {}
        for ni, name in enumerate(names):
            enums[name] = ni

        return type("Enum", (), enums)


class LineHelper:
    @staticmethod
    def get_line_2d_angle(linestring, is_radians=True):
        """Calculate angle between two points

        Args:
            linestring (Rhino.Geometry.Curve): Segment with only two points
            is_radians (bool, optional): If False return to degree. Defaults to True.

        Returns:
            float: Angle of given linestring
        """

        x1, y1, _ = linestring.PointAtStart
        x2, y2, _ = linestring.PointAtEnd

        angle = math.atan2(y2 - y1, x2 - x1)
        if is_radians:
            return angle

        return math.degrees(angle)

    @staticmethod
    def get_2d_obb_from_line(linestring, geom):
        """Create an oriented bounding box by given axis of linestring

        Args:
            linestring (Rhino.Geometry.Curve): Alignment axis
            geom (Rhino.Geometry.Curve): Geometry to create the obb

        Returns:
            Rhino.Geometry.Rectangle3d: Oriented bounding box aligned to given line axis
        """
        angle = LineHelper.get_line_2d_angle(linestring)

        anchor = PointHelper.get_points_cloud_centroid(
            LineHelper.get_curve_vertices(linestring)
        )

        if linestring.IsClosed:
            anchor = geom.ToPolyline().CenterPoint()

        negative_transform = rg.Transform.Rotation(-angle, anchor)
        positive_transform = rg.Transform.Rotation(angle, anchor)

        copied_geom = copy.copy(geom)
        copied_geom.Transform(negative_transform)

        obb = copied_geom.GetBoundingBox(rg.Plane.WorldXY)
        obb = rg.Rectangle3d(rg.Plane.WorldXY, obb.Min, obb.Max)
        obb.Transform(positive_transform)

        return obb

    @staticmethod
    def get_sorted_segment(linestring, is_sort_by_longest=False):
        """Get sorted segments based on the length of each segment

        Args:
            linestring (Rhino.Geometry.Curve): To sort curve
            is_sort_by_longest (bool, optional): Sorting criteria. Defaults to False.

        Returns:
            List[Rhino.Geometry.Curve]: Sorted segments
        """

        exploded_linestring = linestring.DuplicateSegments()
        sorted_linestring = sorted(
            exploded_linestring,
            key=lambda l: l.GetLength(),
            reverse=is_sort_by_longest,
        )

        return sorted_linestring

    @staticmethod
    def get_2d_offset_polygon(linestring, distance, plane=rg.Plane.WorldXY):
        """Create a polygon through the given opened curve

        Args:
            linestring (Rhino.Geometry.Curve): Curve to make as a polygon
            distance (float): Distance to offset
            plane (Rhino.Geometry.Plane, optional): Offset plane
                                                    Defaults to WorldXY

        Raises:
            Exception: When closed curve

        Returns:
            Rhino.Geometry.Curve: Offset polygon
        """

        if linestring.IsClosed:
            raise Exception("Given linestring has been closed")

        offset_linestring_list = list(
            linestring.Offset(
                plane,
                distance,
                ConstsCollection.TOLERANCE,
                rg.CurveOffsetCornerStyle.Sharp,
            )
        )

        vertices = []
        exploded_linestring = linestring.DuplicateSegments()
        for li, each_line in enumerate(exploded_linestring):
            vertices.append(each_line.PointAtStart)
            if li == len(exploded_linestring) - 1:
                vertices.append(each_line.PointAtEnd)

        offset_vertices = []
        for offset_line in offset_linestring_list:
            exploded_offset_linestring = offset_line.DuplicateSegments()

            for oli, each_offset_line in enumerate(exploded_offset_linestring):
                offset_vertices.append(each_offset_line.PointAtStart)
                if oli == len(exploded_offset_linestring) - 1:
                    offset_vertices.append(each_offset_line.PointAtEnd)

        return rg.PolylineCurve(vertices + offset_vertices[::-1] + vertices[:1])

    @staticmethod
    def get_2d_buffered_linestring(linestring, distance, is_single_side=False):
        """Create a linestring has width

        Args:
            linestring (Rhino.Geometry.Curve): Target curve
            distance (float): Width

        Returns:
            List[Rhino.Geometry.Curve]: Buffered linestring
        """

        linestring = LineHelper.get_simplified_curve(linestring)
        
        if isinstance(linestring, Iterable):
            
        
        exploded_linestring = []
        
        exploded_linestring = linestring.DuplicateSegments()
        first_line = exploded_linestring[0]

        is_plane_creation_succeed, section_plane = first_line.FrameAt(0)
        if not is_plane_creation_succeed:
            angle = LineHelper.get_line_2d_angle(first_line)
            transform = rg.Transform.Rotation(angle, section_plane.Origin)

            section_plane.Transform(transform)
            section_plane.Origin = first_line.PointAtStart

        vector_1 = section_plane.YAxis * distance / 2
        vector_2 = -section_plane.YAxis * distance / 2

        if is_single_side:
            vector_1 = section_plane.YAxis * distance
            vector_2 = -section_plane.YAxis * 0

        section = rg.Line(
            linestring.PointAtStart + vector_1,
            linestring.PointAtStart + vector_2,
        ).ToNurbsCurve()

        buffered_linestring = rg.Brep.CreateFromSweep(
            rail=linestring,
            shape=section,
            closed=True,
            tolerance=ConstsCollection.TOLERANCE,
        )

        buffered_linestring_outer = []
        for line in buffered_linestring:
            buffered_linestring_outer.extend(
                list(line.DuplicateNakedEdgeCurves(True, False))
            )

        return list(rg.Curve.JoinCurves(buffered_linestring_outer))

    @staticmethod
    def get_curve_vertices(linestring):
        """Get vertices from given linestring

        Args:
            linestring (Rhino.Geometry.Curve): Given curve

        Returns:
            List[Rhino.Geometry.Point3d]: Vertices to curve
        """

        vertices = []
        exploded_linestring = linestring.DuplicateSegments()
        is_closed = linestring.IsClosed

        if len(exploded_linestring) == 1:
            vertices.extend(
                [
                    exploded_linestring[0].PointAtStart,
                    exploded_linestring[0].PointAtEnd,
                ]
            )

        else:
            for li, line in enumerate(exploded_linestring):
                vertices.append(line.PointAtStart)

                if li == len(exploded_linestring) - 1 and not is_closed:
                    vertices.append(line.PointAtEnd)

        return vertices

    @staticmethod
    def get_2d_convexhull(points):
        """Create 2d convex hull about given points

        Args:
            points (Rhino.Geometry.Point3d): Points to create convex hull

        Returns:
            Rhino.Geometry.Curve: 2d Convex hull
        """

        def cross(a, b, c):
            return (b.X - a.X) * (c.Y - a.Y) - (b.Y - a.Y) * (c.X - a.X)

        start = min(points, key=lambda p: (p.Y, p.X))
        sorted_points = sorted(
            points,
            key=lambda p: (math.atan2(p.Y - start.Y, p.X - start.X), p.X, p.Y),
        )
        hull = [start]
        for p in sorted_points:
            while len(hull) >= 2 and cross(hull[-2], hull[-1], p) <= 0:
                hull.pop()

            hull.append(p)

        return rg.PolylineCurve(hull + [start])

    @staticmethod
    def get_2d_minimum_obb(geom):
        """Create the minimum oriented bounding box about given geometry

        Args:
            geom (Rhino.Geometry.Curve): Geometry to make minimum obb

        Returns:
            Rhino.geometry.Rectangle3d: Minimum obb
        """
        geom_vertices = LineHelper.get_curve_vertices(geom)
        geom_convexhull_segements = list(
            LineHelper.get_2d_convexhull(geom_vertices).DuplicateSegments()
        )

        obbs = []
        for hull_segment in geom_convexhull_segements:
            each_obb = LineHelper.get_2d_obb_from_line(hull_segment, geom)
            obbs.append(each_obb)

        return sorted(obbs, key=lambda b: b.Area)[0]

    @staticmethod
    def get_removed_overlapped_curves(curves, is_needed_for_points=False):
        """Remove overlapping curves

        Args:
            curves (List[Rhino.Geometry.Curve]): Target curves to remove duplicates

        Returns:
            List[Rhino.Geometry.Curve]: Curves with duplicates removed
        """

        result_curves = []
        for edge in curves:
            exploded_edge = edge.DuplicateSegments()
            result_curves.extend(exploded_edge)

        ei = 0
        while ei < len(result_curves):
            edge = result_curves[ei]
            edge_centroid = edge.PointAtLength(edge.GetLength() / 2)
            other_curves = result_curves[:ei] + result_curves[ei + 1 :]

            for other_edge in other_curves:
                other_edge_centroid = other_edge.PointAtLength(
                    other_edge.GetLength() / 2
                )

                intersections = rg.Intersect.Intersection.CurveCurve(
                    edge,
                    other_edge,
                    ConstsCollection.TOLERANCE,
                    ConstsCollection.TOLERANCE,
                )

                is_same_centroid = PointHelper.is_same_points(
                    edge_centroid, other_edge_centroid
                )

                for intsc in intersections:
                    if (
                        intsc.IsOverlap
                        and is_same_centroid
                        and edge in result_curves
                    ):
                        result_curves.remove(edge)
                        ei += -1

            ei += 1

        if is_needed_for_points:
            result_points = []
            for edge in result_curves:
                result_points.extend([edge.PointAtStart, edge.PointAtEnd])
            result_points = rg.Point3d.CullDuplicates(
                result_points, ConstsCollection.TOLERANCE
            )

            return result_curves, result_points

        return result_curves

    @staticmethod
    def get_simplified_curve(linestring):
        """Custom curve simplification method

        Args:
            linestring (Rhino.Geometry.Curve): Curve to simplify

        Returns:
            Rhino.Geometry.Curve: Simplified curve
        """

        exploded_input_poly = linestring.DuplicateSegments()

        simplified = [exploded_input_poly[0]]

        si = 0
        while si < len(exploded_input_poly):
            curr_segment = exploded_input_poly[si]
            prev_segment = simplified[-1]
            next_segment = simplified[0]

            is_last_si = si == len(exploded_input_poly) - 1

            curr_segment_angle = LineHelper.get_line_2d_angle(curr_segment)
            prev_segment_angle = LineHelper.get_line_2d_angle(prev_segment)
            next_segment_angle = LineHelper.get_line_2d_angle(next_segment)

            is_needed_merge_curr_and_prev = NumericHelper.is_close(
                curr_segment_angle, prev_segment_angle
            ) and PointHelper.is_same_points(
                prev_segment.PointAtEnd, curr_segment.PointAtStart
            )

            is_needed_merge_curr_and_next = (
                NumericHelper.is_close(curr_segment_angle, next_segment_angle)
                and PointHelper.is_same_points(
                    curr_segment.PointAtEnd, next_segment.PointAtStart
                )
                and is_last_si
            )

            if is_needed_merge_curr_and_prev and is_needed_merge_curr_and_next:
                vertex_1 = LineHelper.get_curve_vertices(simplified[-1])[0]
                vertex_2 = LineHelper.get_curve_vertices(simplified[0])[-1]
                simplified.append(rg.PolylineCurve([vertex_1, vertex_2]))

                del simplified[0]
                del simplified[-2]

            elif is_needed_merge_curr_and_prev:
                vertex_1 = LineHelper.get_curve_vertices(prev_segment)[0]
                vertex_2 = LineHelper.get_curve_vertices(curr_segment)[-1]
                simplified[-1] = rg.PolylineCurve([vertex_1, vertex_2])

            elif is_needed_merge_curr_and_next:
                vertex_1 = LineHelper.get_curve_vertices(curr_segment)[0]
                vertex_2 = LineHelper.get_curve_vertices(next_segment)[-1]
                simplified.append(rg.PolylineCurve([vertex_1, vertex_2]))

                del simplified[0]

            else:
                if si != 0:
                    simplified.append(curr_segment)

            si += 1

        return rg.Curve.JoinCurves(simplified)

    @staticmethod
    def get_curve_sublinestring(linestring, start, length):
        """Get the given linestring's substring

        Args:
            linestring (Rhino.Geometry.Curve): Linestring to get the substring
            start (float): Start location
            length (float): Length of Substring

        Returns:
            Rhino.Geometry.Curve: Sublinestring
        """

        splitted_curve = linestring.Split([float(start), start + float(length)])

        if start <= 0:
            return splitted_curve[0]

        return splitted_curve[1]


class NumericHelper:
    @staticmethod
    def is_close(n1, n2, tolerance=ConstsCollection.TOLERANCE):
        """Check if two numbers are within margin of error

        Args:
            n1 (float): Number to compare
            n2 (float): Number to compare
            tolerance (float, optional): Permissible range. Defaults to ConstsCollection.TOLERANCE.

        Returns:
            bool: Compare result about whether two numbers are equal
        """

        return abs(n1 - n2) <= tolerance

    @staticmethod
    def all_close(nums, target, tolerance=ConstsCollection.TOLERANCE):
        """Check whether all numbers are the same as the target

        Args:
            nums (List[float]): Numbers to compare
            target (float): Target number to compare
            tolerance (float, optional): Permissible range. Defaults to ConstsCollection.TOLERANCE.

        Returns:
            bool: Compare result about whether all numbers are equal
        """

        return all(
            NumericHelper.is_close(num, target, tolerance) for num in nums
        )


class SurfaceHelper:
    @staticmethod
    def get_reparameterized_surface(srf):
        """Change domain to 0 ~ 1 given surface

        Args:
            srf (Rhino.Geometry.Surface): Surface to reparameterize

        Returns:
            Rhino.Geometry.Surface: Reparameterized surface
        """

        interval = rg.Interval(0, 1)

        copied_srf = copy.copy(srf)
        copied_srf.SetDomain(0, interval)
        copied_srf.SetDomain(1, interval)

        return copied_srf


class PointHelper:
    @staticmethod
    def get_points_cloud_centroid(points):
        """Find a centroid of given points.

        Args:
            points (List[Rhino.Geometry.Point3d]): Points cloud

        Returns:
            Rhino.Geometry.Point3d: Centroid of points cloud
        """

        return rg.Point3d(
            *[sum(coord_list) / len(points) for coord_list in zip(*points)]
        )

    @staticmethod
    def get_projected_point_on_curve(anchor, vector, geometry):
        """Calculate the projected point on the curve through the given point and vector

        Args:
            anchor (Rhino.Geometry.Point3d): Point to project
            vector (Rhino.Geometry.Vector3d): Projection direction
            geometry (Rhino.Geometry.Curve): Geometry to project

        Raises:
            Exception: When given geometry is not curve

        Returns:
            Rhino.Geometry.Point3d: Projected point. if not intersects, return None.
        """

        if not isinstance(geometry, rg.Curve):
            raise Exception("Unsupported geometry.")

        ray = rg.PolylineCurve([anchor, anchor + vector * ConstsCollection.INF])
        intersection = rg.Intersect.Intersection.CurveCurve(
            geometry,
            ray,
            ConstsCollection.TOLERANCE,
            ConstsCollection.TOLERANCE,
        )

        projected_point = None
        for intersect in intersection:
            projected_point = intersect.PointA
            break

        return projected_point

    @staticmethod
    def is_same_points(p1, p2):
        """Check whether p1 and p2 are the same

        Args:
            p1 (Rhino.Geometry.Point3d): Point to check
            p2 (Rhino.Geometry.Point3d): Point to check

        Returns:
            bool: Whether two points are the same or not the same
        """

        distance = p1.DistanceTo(p2)
        is_same_points = (
            distance <= 0
            or NumericHelper.is_close(distance, 0)
            or p1.Equals(p2)
        )

        return is_same_points

    @staticmethod
    def get_normalized_vector(vector):
        """Normalize to vector that length 1.0

        Args:
            vector (Rhino.Geometry.Vector3d): Vector to normalize

        Returns:
            Rhino.Geometry.Vector3d: Normalized vector
        """

        return vector / vector.Length


class VisualizeHelper:
    """
    NOTE: If you RUN(F5) in ghpython scripting window, the text may not remove.
    """

    @classmethod
    def __initialize(cls):
        if CUSTOM_DISPLAY not in globals():
            globals()[CUSTOM_DISPLAY] = rd.CustomDisplay(True)

    @classmethod
    def __dispose(cls):
        globals()[CUSTOM_DISPLAY].Dispose()
        del globals()[CUSTOM_DISPLAY]

    @staticmethod
    def visualize_text(
        string,
        height,
        toggle,
        color=ColorsCollection.COLOR_BLACK,
        string_place_origin=rg.Point3d(0, 0, 0),
        string_place_plane=rg.Plane.WorldXY,
    ):
        """Text visualization helper

        Args:
            string (str): Text to visualize
            height (float): Text size
            toggle (bool): Whether text visualization ON or OFF
            color (Rhino.Display.ColorHSL, optional): Text color. Defaults to ColorHelper.COLOR_BLACK.
            string_place_origin (Rhino.Geometry.Point3d, optional): Location of text. Defaults to rg.Point3d(0, 0, 0).
            string_place_plane (Rhino.Geometry.Plane, optional): Text direction. Defaults to rg.Plane.WorldXY.
        """

        VisualizeHelper.__initialize()
        if not toggle:
            VisualizeHelper.__dispose()
        else:
            string_place_plane.Origin = string_place_origin
            text_3d = rd.Text3d(string, string_place_plane, height)
            globals()[CUSTOM_DISPLAY].AddText(text_3d, color)

    @staticmethod
    def visualize_curve(
        curve, toggle, color=ColorsCollection.COLOR_BLACK, thickness=1
    ):
        """Curve Visualization helper

        Args:
            curve (Rhino.Geometry.Curve): Curve to visualize
            toggle (bool): Whether curve visualization ON or OFF
            color (Rhino.Display.ColorHSL, optional): Curve color. Defaults to ColorHelper.COLOR_BLACK.
            thickness (int, optional): Curve display thickness. Defaults to 1.
        """

        VisualizeHelper.__initialize()
        if not toggle:
            VisualizeHelper.__dispose()
        else:
            globals()[CUSTOM_DISPLAY].AddCurve(curve, color, thickness)

    @staticmethod
    def visualize_polygon(
        polygon,
        toggle,
        fill_color=ColorsCollection.COLOR_GRAY,
        edge_color=ColorsCollection.COLOR_BLACK,
        draw_fill=True,
        draw_edge=True,
    ):
        """Polygon visualization helper

        Args:
            polygon (List[Point3d]): Polygon to visualize
            toggle (bool): Whether polygon visualization ON or OFF
            fill_color (Rhino.Display.ColorHSL, optional): Polygon's inner color. Defaults to ColorHelper.COLOR_GRAY.
            edge_color (Rhino.Display.ColorHSL, optional): Polygon's edge color. Defaults to ColorHelper.COLOR_BLACK.
            draw_fill (bool, optional): Whether polygon inside fill. Defaults to True.
            draw_edge (bool, optional): Whether polygon edge visualization. Defaults to True.

        NOTE:
            This function is incomplete. Sometimes the concave part of the polygon is convexly filled
        """

        VisualizeHelper.__initialize()
        if not toggle:
            VisualizeHelper.__dispose()
        else:
            globals()[CUSTOM_DISPLAY].AddPolygon(
                polygon, fill_color, edge_color, draw_fill, draw_edge
            )
# ---------- end ghpython_script_2 ----------
boundary_surfaces_2 = BoundarySurfaces(Edges=move.Geometry)
custom_preview_lineweights_5 = CustomPreviewLineweights(Geometry=move_2.Geometry, Shader=colour_swatch, Thickness=3, Absolute=False)
move_4 = Move(Geometry=geometry, Motion=multiplication)  # -> Geometry, Transform
move_5 = Move(Geometry=polyline_6, Motion=multiplication)  # -> Geometry, Transform
move_6 = Move(Geometry=[polyline, polyline_2, polyline_6], Motion=multiplication)  # -> flatten(Geometry), Transform
ghpython_script_3 = GhPythonScript(grid=boundary_surfaces_2)  # -> out, grid_clusters, grid_clusters_colors; inputs grid: tree of Curve
# ---------- ghpython_script_3: Python ----------
from ghpythonutils.utils.kmeans.kmeans import KMeans
from ghpythonlib.treehelpers import list_to_tree
import rhinoscriptsyntax as rs
import random

#random.seed(115)/

grid_clusters_colors = []
for branch in grid.Branches:
    
    r = random.randint(0, 150)
    g = random.randint(0, 150)
    b = random.randint(0, 150)
    
    grid_clusters_colors.append(
        [rs.CreateColor(r, g, b)] * len(branch)
    )

grid_clusters_colors = list_to_tree(grid_clusters_colors)
# ---------- end ghpython_script_3 ----------
boundary_surfaces_3 = BoundarySurfaces(Edges=move_4.Geometry)
custom_preview_lineweights_6 = CustomPreviewLineweights(Geometry=move_5.Geometry, Shader=colour_swatch, Thickness=3, Absolute=False)
move_7 = Move(Geometry=ghpython_script.krooms, Motion=multiplication)  # -> flatten(Geometry), Transform
region_difference = RegionDifference(CurvesA=move_7.Geometry, CurvesB=move_4.Geometry)
custom_preview = CustomPreview(Geometry=boundary_surfaces_2, Material=ghpython_script_3.grid_clusters_colors)
custom_preview_2 = CustomPreview(Geometry=boundary_surfaces_3, Material=ColourSwatch(SwatchColor=RGB(0, 0, 0)))
list_item_3 = ListItem(List=region_difference, Index=[1, 3], Wrap=True)
custom_preview_lineweights_7 = CustomPreviewLineweights(Geometry=list_item_3, Shader=ColourSwatch(SwatchColor=RGB(255, 0, 0)), Thickness=4, Absolute=False)
