# Grasshopper definition shortestpath.gh (Grasshopper 1.0.7)
# plug-ins: Shortest Walk in Gh, Human

number_slider = Slider(38, range=0..81)
number_slider_2 = Slider(0, range=0..81)
curve = Curve([<curve referenced from the Rhino model> x59])
point = Point(Point(78.46793694, 0, 0))
curve_2 = Curve([<curve referenced from the Rhino model> x9])
move = Move(Geometry=curve_2, Motion=point)  # -> Geometry, Transform
point_2 = Point(Point(223.6484272, 78.9015423, 0))
length = Length(Curve=curve_2)
point_3 = Point(Point(256.7085585, 76.68409447, 0))
move_2 = Move(Geometry=point_2, Motion=point)  # -> Geometry, Transform
move_3 = Move(Geometry=point_3, Motion=point)  # -> Geometry, Transform
ghpython_script = GhPythonScript(network=move.Geometry, start=move_2.Geometry, target=move_3.Geometry)  # -> out, edges, shortestLine, vertices, curves, v, a; inputs network: list of Curve, mesh: Mesh, start: Point3d, target: Point3d
# ---------- ghpython_script: Python ----------
__author__ = "Gizem Yetis"
__institution__ = "Middle East Technical University, Department of Architecture, Building Science"
__mail__ = "gizemyetis93@gmail.com"

import heapq
#from heapq import *

import sys
import rhinoscriptsyntax as rs
import Rhino.Geometry as rg
import itertools

from ghpythonutils.utils.utils import LineHelper, PointHelper


class Vertex:
    def __init__(self, vi, geom):
        self.vi = vi
        self.geom = geom
        
        self.adjacent = {}
        self.distance = sys.maxint
        self.is_visited = False  
        self.previous = None

    def __repr__(self):
        return (
            str(self.vi) + "th vertex" 
            + ': adjacent ->' 
            + str([v.vi for v in self.adjacent])
        )
    
    @property
    def distance(self):
        return self.distance
    
    @distance.setter
    def distance(self, distance):
        self.distance = distance
        
    @property
    def is_visited(self):
        return self.is_visited
        
    @is_visited.setter
    def is_visited(self, is_visited):
        self.is_visited = is_visited
        
    def get_connections(self):
        return self.adjacent.keys()  

    def get_vertex_index(self):
        return self.vi

    def get_cost(self, neighbor):
        return self.adjacent[neighbor]

    def set_previous(self, prev):
        self.previous = prev

    def set_neighbor(self, neighbor, cost):
        self.adjacent[neighbor] = cost

class Graph(PointHelper, LineHelper):
    def __init__(self, input_curves):
        self.input_curves = input_curves
        self.vertices = vertices
        
        PointHelper.__init__(self)
        LineHelper.__init__(self)
        self._generate()

    def __iter__(self):
        return iter(self.graph_dict.values())
        
    def _generate(self):
        self._gen_network()
        self._gen_graph()
        
    def _gen_network(self):
        self.curves, self.vertices = self.get_removed_overlapped_curves(
            self.input_curves, is_needed_for_points=True
        )
        
        self.network = []
        for curve in self.curves:
            curve_start_point = curve.PointAtStart
            curve_end_point = curve.PointAtEnd
            
            data = []
            for vi, vertex in enumerate(self.vertices):
                if self.is_same_points(curve_start_point, vertex):
                    data.append(vi)
                
                elif self.is_same_points(curve_end_point, vertex):
                    data.append(vi)
                    
                if len(data) == 2:
                    break
                    
            self.network.append([data, curve])
        
    def _gen_graph(self):
        self.graph_dict = {}
        for vi, vertex in enumerate(self.vertices):
            self.graph_dict[vi] = Vertex(vi, vertex)
        
        for di, data in enumerate(self.network):
            (start_vi, end_vi), edge_geom = data
            cost = edge_geom.GetLength()
            self.graph_dict[start_vi].set_neighbor(self.graph_dict[end_vi], cost)
            self.graph_dict[end_vi].set_neighbor(self.graph_dict[start_vi], cost)
        
    def get_vertex(self, n):
        if n in self.graph_dict:
            return self.graph_dict[n]
        else:
            return None

    def get_vertices(self):
        return self.graph_dict.keys()

    def set_previous(self, current):
        self.previous = current

    def get_previous(self, current):
        return self.previous

def shortpath(v, path):
    if v.previous:
        path.append(v.previous.get_vertex_index())
        shortpath(v.previous, path)


class Dijkstra(Graph):
    def __init__(self, network, start_point, target_point):
        self.network = network
        self.start_point = start_point
        self.target_point = target_point
        
        Graph.__init__(self, network)
        self._run()
        
    def _run(self):
        self._gen_estimated_path()
        self._relax()
        
    def _gen_estimated_path(self):
        for vi, vertex in enumerate(self.vertices):
            is_start_vertex = (
                isinstance(self.start_point, rg.Point3d) 
                and self.is_same_points(self.start_point, vertex)
            )
            is_target_vertex = (
                isinstance(self.target_point, rg.Point3d) 
                and self.is_same_points(self.target_point, vertex)
            )
            
            if is_start_vertex:
                self.start_index = vi
            elif is_target_vertex:
                self.target_index = vi
                
    def _relax(self):
        start_vertex = self.get_vertex(self.start_index)
        start_vertex.distance = 0
        
        unvisited_queue = [(v.distance, v) for v in self]
        heapq.heapify(unvisited_queue)
        
        while len(unvisited_queue) != 0:
            current_distance, current_vertex = heapq.heappop(unvisited_queue)
            current_vertex.is_visited = True
            
            print(current_vertex)
            for adjacent_vertex in current_vertex.adjacent:
                print(adjacent_vertex)
                if adjacent_vertex.is_visited:
                    continue
                
                new_dist = current_distance + current_vertex.get_cost(adjacent_vertex)
                
                if new_dist < adjacent_vertex.distance:
                    adjacent_vertex.distance = new_dist
                    adjacent_vertex.set_previous(current_vertex)
            
            print()
            print()
            while len(unvisited_queue) != 0:
                heapq.heappop(unvisited_queue)
            
            unvisited_queue = [(v.distance, v) for v in self if not v.is_visited]
            heapq.heapify(unvisited_queue)
        
if __name__ == "__main__":
    
    d = Dijkstra(network, start, target)
    
    target = d.get_vertex(d.target_index)
    path = [target.get_vertex_index()]
    shortpath(target, path)
    #print 'The shortest path : %s' %(path[::-1])
    
    
    ptsLine = [d.vertices[p] for p in path]
    if len(ptsLine) <= 1:
        shortestLine = []
    else:
        shortestLine = rs.AddPolyline(ptsLine)
    
    vertices = d.vertices
# ---------- end ghpython_script ----------
list_item = ListItem(List=ghpython_script.curves, Index=Slider(7, range=0..8), Wrap=True)
point_list = PointList(Points=ghpython_script.vertices, Size=3)
geometry = Geometry(ghpython_script.curves)
geometry_2 = Geometry(list_item)
custom_preview_lineweights = CustomPreviewLineweights(
    Geometry=ghpython_script.shortestLine,
    Shader={diffuse=RGB(255, 105, 180), emission=RGB(76, 32, 54), shine=0.5, specular=RGB(255, 255, 255), transparency=0},
    Thickness=5,
    Absolute=False)
custom_preview_lineweights_2 = CustomPreviewLineweights(Geometry=geometry_2, Shader=ColourSwatch(SwatchColor=RGB(0, 0, 0)), Thickness=5, Absolute=False)
list_item_2 = ListItem(List=curve_2, Index=Slider(8, range=0..8), Wrap=True)
line = Line(StartPoint=point_2, EndPoint=point_3)
shortest_walk = ShortestWalk(Curves=curve_2, Lengths=length, WantedPath=line)  # -> ShortestWalk, Succession, Direction, Length
custom_preview_lineweights_3 = CustomPreviewLineweights(
    Geometry=shortest_walk.ShortestWalk,
    Shader={diffuse=RGB(255, 105, 180), emission=RGB(76, 32, 54), shine=0.5, specular=RGB(255, 255, 255), transparency=0},
    Thickness=5,
    Absolute=False)
