# Grasshopper definition kmeans.gh (Grasshopper 1.0.7)

rectangle = Rectangle({Plane=PlaneXY(184, 22, 0), Size=Domain2(u=-63..63, v=-27..27)})
populate_2d = Populate2D(Region=rectangle, Count=700, Seed=1)
ghpython_script = GhPythonScript(points=populate_2d)  # -> out, points_clusters, points_clusters_colors; inputs points: list of Point3d
# ---------- ghpython_script: Python ----------
from ghpythonutils.utils.kmeans.kmeans import KMeans
from ghpythonlib.treehelpers import list_to_tree
import rhinoscriptsyntax as rs
import random

kmeans = KMeans(points=points, k=10, random_seed=90)
points_clusters = kmeans.predict()
points_clusters = list_to_tree(points_clusters)

points_clusters_colors = []
for branch in points_clusters.Branches:
    
    r = random.randint(0, 255)
    g = random.randint(0, 255)
    b = random.randint(0, 255)
    
    points_clusters_colors.append(
        [rs.CreateColor(r, g, b)] * len(branch)
    )

points_clusters_colors = list_to_tree(points_clusters_colors)
# ---------- end ghpython_script ----------
point = Point(Point(136.4825907, 0, 0))
move = Move(Geometry=ghpython_script.points_clusters, Motion=point)  # -> Geometry, Transform
custom_preview = CustomPreview(Geometry=move.Geometry, Material=ghpython_script.points_clusters_colors)
